vi "HamCodeInterleav.gvi"   [LabVIEW NXG]
panel controls:
  "stop": bool
panel indicators:
  "8 sample Hamming Coded": f64[][]
  "Interleaved": f64[][]
  "Deinterleaved": f64[][]
  "8 sample Hamming Decoded": f64[][]
diagram:
  while {
    for (N = 8) (iteration -> i1) {
      Initialize Array(element=0, size=0) -> w1
      for (N = 4) (iteration -> i2) {
        Random Number() -> (number (0 to 1)=w2)
        Is Greater(x=w2, y=0.5) -> w3
        Select(s=w3, t=1, f=0) -> w4
        Insert Into Array(inArray=w5, index0=i2, new=w4) -> w6
        Feedback Node(Initializer=w1, Input=w6) -> (Output=w5)
      }
      Math Node("in"=w6) -> ("out"=w7)
      ~~~
      out=zeros(1,7);

          for i=0:3
              out(i+1) = in(i+1);
          end

          out(5) = mod ( in(1) + in(2) + in(4 ) , 2 );
          out(6) = mod ( in(1) + in(3) + in(4) , 2 );
          out(7) = mod ( in(2) + in(3) + in(4) , 2 );

      ~~~
      Feedback Node(Input=w8) -> (Output=w9)
      Insert Into Array(inArray=w9, index0=i1, new=w7) -> w8
    }
    $"8 sample Hamming Coded" <- w8
    Math Node("in"=w8, "n"=8, "l"=7) -> ("out"=w10)
    ~~~
        out = zeros(n*l,1);
        for i=1:n
            for j=1:l
                out(i+n*(j-1))=in(i,j);
            end
        end
    ~~~
    $Interleaved <- w10
    Math Node("in"=w10, "n"=8, "l"=7) -> ("out"=w11)
    ~~~
        out = zeros(n,l);
        for i=1:n
            for j=1:l
                out(i,j)=in(i+n*(j-1));
            end
        end
    ~~~
    for (N = 8) (iteration -> i3) {
      Array Index(array=w11) -> (out0[i3, _]=w12)
      Math Node("in"=w12) -> ("out"=w13)
      ~~~
          out=zeros(1,4);

          errors=[0,0,0];
          if ( not ( mod ( in(1) + in(2) + in(4) + in(5) , 2 ) == 0 ))
              errors(1)=1;
          end
          if ( not ( mod ( in(1) + in(3) + in(4) + in(6) , 2 ) == 0 ))
              errors(2)=1;
          end
          if ( not ( mod ( in(2) + in(3) + in(4) + in(7) , 2 ) == 0 ))
              errors(3)=1;
          end



          errorFlag=false;

          if sum(errors)==1
              errorFlag=true;
          end
          if sum(errors)==2
              if errors(1)==1&&errors(2)==1
                  in(1)=1-in(1);
              end
              if errors(1)==1&&errors(3)==1
                  in(2)=1-in(2);
              end
              if errors(2)==1&&errors(3)==1
                  in(3)=1-in(3);
              end
          end
          if sum(errors)==3
              in(4)=1-in(4);
          end

          for i=1:4
              out(i)=in(i);
          end
      ~~~
      Feedback Node(Input=w14) -> (Output=w15)
      Insert Into Array(inArray=w15, index0=i3, new=w13) -> w14
    }
    $"8 sample Hamming Decoded" <- w14
    $Deinterleaved <- w11
    Wait Ms(msToWait=10000)
    stop if $stop
  }
