vi "ldpcDecoding.gvi"   [LabVIEW NXG]
inputs:
  "ReceivedMessage": i32[]
  "CheckMatrix": f64[][]
  "itMax": i32
  "Hposition": f64[][]
  "correct": bool
outputs:
  "MesageDecoded": i32[]
panel controls:
  "matscript": bool
panel indicators:
  "Syndrom": f64[]
  "loop iteration": i32
  "Variable: out": i32[]
  "error": i32
  "sizeMessage": i32
  "sizeCheckMatrix": i32[]
  "sizeSyndrom": i32
  "sizeSyndrom_2": i32
  "x - 1": f64[][]
  "res": f64[]
  "notRes": f64[]
diagram:
  Array Size(array=$ReceivedMessage) -> (size(s)=w1)
  $sizeMessage <- w1
  Array Size(array=$CheckMatrix) -> (size(s)=w2)
  $sizeCheckMatrix <- w2
  Array Index(array=w2) -> (out0[1]=w3)
  Is Equal(x=w3, y=w1) -> w4
  Logical And($correct, w4) -> w5
  case (w5) {
    frame False, Default {
      w6 = $ReceivedMessage
    }
    frame True {
      s1 = $ReceivedMessage  # shift register
      while (iteration -> i1) {
        call "A x Vector.gvi"(A=$CheckMatrix, Vector=s1) -> (A x Vector=w7, error=w8)
        Array Size(array=w7) -> (size(s)=w9)
        $sizeSyndrom_2 <- w9
        Quotient And Remainder(x=w7, y=2) -> (x-y*floor(x/y)=w10)
        Array Size(array=w10) -> (size(s)=w11)
        $sizeSyndrom <- w11
        $Syndrom <- w10
        $error <- w8
        case ($matscript) {
          frame False, Default {
            Decrement(x=$Hposition) -> w13
            Initialize Array(element=0, size=w1) -> w14
            Initialize Array(element=0, size=w1) -> w15
            Array Size(array=w13) -> (size(s)=w16)
            Array Index(array=w16) -> (out0[0]=w17)
            s2 = w15  # shift register
            s3 = w14  # shift register
            for (N = w17) {
              w18 = each element of w13
              w19 = each element of w10
              Is Equal To 0(x=w19) -> w20
              # For check from 1 to m
              s4 = 0  # shift register
              s5 = s3  # shift register
              s6 = s2  # shift register
              while {
                Array Index(array=w18) -> (out0[s4]=w21)
                case (w20) {
                  frame False, Default {
                    Array Index(array=s6) -> (out0[w21]=w24)
                    Increment(x=w24) -> w25
                    Insert Into Array(inArray=s6, index0=w21, new=w25) -> w23
                    w22 = s5
                  }
                  frame True {
                    Array Index(array=s5) -> (out0[w21]=w26)
                    Increment(x=w26) -> w27
                    Insert Into Array(inArray=s5, index0=w21, new=w27) -> w22
                    w23 = s6
                  }
                }
                Increment(x=s4) -> w28
                Array Size(array=w18) -> (size(s)=w29)
                Is Less(x=w29, y=w28) -> w30
                Array Index(array=w18) -> (out0[w28]=w31)
                Is Less Than 0(x=w31) -> w32
                Logical Or(w30, w32) -> w33
                next s4 = w28
                next s5 = w22
                next s6 = w23
                stop if w33
              }
              next s2 = s6
              next s3 = s5
            }
            for (N = w1) {
              w34 = each element of s3
              w35 = each element of s2
              w36 = each element of s1
              Is Greater(x=w34, y=w35) -> w37
              case (w37) {
                frame False, Default {
                  Subtract(x=1, y=w36) -> w38
                }
                frame True {
                  w38 = w36
                }
              }
              append w38 to w12
            }
            $res <- s3
            $notRes <- s2
            $"x - 1" <- w13
          }
          frame True {
            Math Node("syndrom"=w10, "H"=$CheckMatrix, "in"=s1, "Hposition"=$Hposition) -> ("out"=w12)
            ~~~
            m=size(H,1);    % Number of checks
            n=size(H,2);    % Number of bits in codeword
            k=n-m;


            % Find the checks that are not respected
            syndrom;

            % For each bit count the number of checks respected and not respected
            res=zeros(1,n);
            notRes=zeros(1,n);

            for check=1:m
                count=1
                bit=Hposition(check,count)
                while and(bit~=0, count<=n)
                    if syndrom(1, check)==1
                        notRes(bit)=notRes(bit)+1;
                    else
                        res(bit)=res(bit)+1;
                    end
                    count=count+1;
                    if count<=n
                        bit=Hposition(check,count);
                    end
                end
            end

            % if more not respected flip the bit
            for bit=1:n
                if notRes(bit)>res(bit)
                    in(bit)=mod(in(bit)+1,2);
                end
            end

            out=in;
            ~~~
          }
        }
        $"Variable: out" <- w12
        $"loop iteration" <- i1
        Add Array Elements(numeric array=w10) -> (sum=w39)
        Is Equal To 0(x=w39) -> w40
        Is Greater(x=i1, y=$itMax) -> w41
        Logical Or(w41, w40) -> w42
        next s1 = w12
        stop if w42
      }
      w6 = s1
    }
  }
  Array Index(array=w2) -> (out0[0]=w43)
  Array Index(array=w2) -> (out0[1]=w44)
  Subtract(x=w44, y=w43) -> w45
  Array Subset(array=w6, index0=w43, length0=w45) -> w46
  $MesageDecoded <- w46
