vi "ldpcDenseCoding.gvi"   [LabVIEW NXG]
inputs:
  "Message": f64[]
  "GeneratorMatrixLocation": path
outputs:
  "EncodedMessage": f64[]
  "GeneratorMatrix": f64[][]
panel indicators:
  "GeneratorMatrixSize": i32[]
  "error": i32
diagram:
  call "Read from Spreadsheet File (DBL).gvi"(file path=$GeneratorMatrixLocation, format="%.3f", delimiter=",") -> (all rows=w1)
  Array Size(array=w1) -> (size(s)=w2)
  Array Index(array=w2) -> (out0[0]=w3)
  call "Create Special Real Matrix.gvi"(matrix size=w3) -> (special matrix=w4)
  Build Array[ConcatenateInputs=True](w1, w4) -> w5
  Array Size(array=w5) -> (size(s)=w6)
  $GeneratorMatrixSize <- w6
  $GeneratorMatrix <- w5
  call "A x Vector.gvi"(A=w5, Vector=$Message) -> (A x Vector=w7, error=w8)
  Quotient And Remainder(x=w7, y=2) -> (x-y*floor(x/y)=w9)
  $EncodedMessage <- w9
  $error <- w8
