vi "ldpcMatrixTest.gvi"   [LabVIEW NXG]
panel controls:
  "GeneratorMatrixLocation": path
  "CheckMatrixLocation": path
  "inverseHG": bool
  "stop": bool
  "mod2": bool
panel indicators:
  "GenSeedMatrixSize": i32[]
  "CheckMatrixSize": i32[]
  "HxGt": f64[][]
  "GxHtSize": i32[]
  "GenMatrixSize": i32[]
  "G": f64[][]
  "H": f64[][]
diagram:
  while {
    call "Read from Spreadsheet File (DBL).gvi"(file path=$CheckMatrixLocation, format="%.3f", delimiter=",") -> (all rows=w1)
    $H <- w1
    Array Size(array=w1) -> (size(s)=w2)
    $CheckMatrixSize <- w2
    call "Read from Spreadsheet File (DBL).gvi"(file path=$GeneratorMatrixLocation, format="%.3f", delimiter=",") -> (all rows=w3)
    Array Size(array=w3) -> (size(s)=w4)
    Array Index(array=w4) -> (out0[0]=w5)
    call "Create Special Real Matrix.gvi"(matrix size=w5) -> (special matrix=w6)
    Build Array[ConcatenateInputs=True](w3, w6) -> w7
    case ($inverseHG) {
      frame False, Default {
        w8 = w7
        w9 = w1
      }
      frame True {
        w8 = w1
        w9 = w7
      }
    }
    call "Real A x B.gvi"(A=w9, B=w8) -> (A x B=w10)
    case ($mod2) {
      frame False, Default {
        w11 = w10
      }
      frame True {
        Quotient And Remainder(x=w10, y=2) -> (x-y*floor(x/y)=w11)
      }
    }
    $HxGt <- w11
    Array Size(array=w11) -> (size(s)=w12)
    $GxHtSize <- w12
    Array Size(array=w3) -> (size(s)=w13)
    $GenSeedMatrixSize <- w13
    Array Size(array=w7) -> (size(s)=w14)
    $GenMatrixSize <- w14
    call "Real Transpose Matrix.gvi"(input matrix=w7) -> (matrix transpose=w15)
    $G <- w15
    stop if $stop
  }
