vi "ldpcTest.gvi"   [LabVIEW NXG]
panel controls:
  "CheckMatrixLocation": path
  "Message": i32[]
  "GeneratorMatrixLocation": path
  "stop": bool
  "messageLength": i32
  "numberNoise": i32
panel indicators:
  "MesageDecoded": i32[]
  "matrixProduct": f64
  "Gsize": i32[]
  "Hsize": i32[]
  "sizeCodedMessage": i32
  "sizeNoisyMessage": i32
  "errorDecoding": i16
  "sumNoisyMessage": f64
diagram:
  call "Read from Spreadsheet File (DBL).gvi"(file path=$GeneratorMatrixLocation, format="%.3f", delimiter=",") -> (all rows=w1)
  call "Read from Spreadsheet File (DBL).gvi"(file path=$CheckMatrixLocation, format="%.3f", delimiter=",") -> (all rows=w2)
  while {
    Initialize Array(element=0, size=$messageLength, size=0) -> w3
    Reshape Array(inArray=w3, size=$messageLength) -> w4
    call "ldpcDenseCoding.gvi"(Message=w4, generatorMatrix=w1) -> (EncodedMessage=w5)
    Build Array[ConcatenateInputs=True](w4, w4) -> w6
    Initialize Array(element=1, size=$numberNoise, size=1) -> w7
    Reshape Array(inArray=w7, size=$numberNoise) -> w8
    Replace Array Subset(inArray=w6, 2, w8) -> w9
    Add(w9, w5) -> w10
    Quotient And Remainder(x=w10, y=2) -> (x-y*floor(x/y)=w11)
    call "ldpcDecoding.gvi"(ReceivedMessage=w11, CheckMatrix=w2, itMax=3) -> (MesageDecoded=w12)
    Is Not Equal(x=w4, y=w12) -> w13
    Boolean To Integer(Boolean=w13) -> (0, 1=w14)
    Add Array Elements(numeric array=w14) -> (sum=w15)
    $errorDecoding <- w15
    Array Size(array=w10) -> (size(s)=w16)
    $sizeNoisyMessage <- w16
    Add Array Elements(numeric array=w10) -> (sum=w17)
    $sumNoisyMessage <- w17
    $MesageDecoded <- w12
    Array Size(array=w2) -> (size(s)=w18)
    $Hsize <- w18
    call "Real A x B.gvi"(A=w2, B=w1) -> (A x B=w19)
    Quotient And Remainder(x=w19, y=2) -> (x-y*floor(x/y)=w20)
    Add Array Elements(numeric array=w20) -> (sum=w21)
    $matrixProduct <- w21
    Array Size(array=w5) -> (size(s)=w22)
    $sizeCodedMessage <- w22
    Array Size(array=w1) -> (size(s)=w23)
    $Gsize <- w23
    stop if $stop
  }
