vi "calcPacketsPerSecond.gvi"   [LabVIEW NXG]
inputs:
  "sync index": f64
  "wanted sync index": f64
  "loop iteration": i32
outputs:
  "iterPerSecond": f64
  "feedbackIterValue": i32
  "absolute value": f64
  "logical AND": bool
panel indicators:
  "stopTickValue": u32
diagram:
  Subtract(x=$"wanted sync index", y=$"sync index") -> w1
  Absolute Value(x=w1) -> w2
  $"absolute value" <- w2
  Is Less(x=w2, y=20) -> w3
  case (w4) {
    frame False, Default {
      w5 = TRUE
      w6 = 0
      w7 = 0
    }
    frame True {
      Tick Count() -> (millisecond timer value=w8)
      # Start counter
      Feedback Node(Initializer=$"loop iteration", Input=w7) -> (Output=w7)
      Subtract(x=$"loop iteration", y=w7) -> w9
      Is Greater(x=w9, y=100) -> w10
      case (w10) {
        frame False, Default {
          w5 = TRUE
          w6 = 0
        }
        frame True {
          Tick Count() -> (millisecond timer value=w11)
          $stopTickValue <- w11
          Subtract(x=w11, y=w8) -> w12
          Divide(x=w12, y=1000) -> w13
          # Stop counter
          Divide(x=w9, y=w13) -> w6
          w5 = FALSE
        }
      }
    }
  }
  Feedback Node(Initializer=TRUE, Input=w5) -> (Output=w14)
  Logical And(w14, w3) -> w4
  $"logical AND" <- w4
  $feedbackIterValue <- w7
  $iterPerSecond <- w6
