vi "Tx_main.gvi"   [LabVIEW NXG]
panel controls:
  "IQ_Rate": f64 = 500000
  "f0": f64 = 2450000000
  "Gain": f64 = 10
  "modulation type": T1 = "PSK"
  "PSK type": enum{"normal", "shifted", "offset"} = "normal"
  "samples per symbol": i32 = 16
  "pulse shaping filter": T2 = "Root Raised Cos"
  "filter parameter": f64 = 0.5
  "filter length": i32 = 8
  "stopRecoringSound": bool
  "stopDataEnqueing": bool
  "stopSendingData": bool
  "SamplesPerChannel": i32 = 128
  "multiple": f64 = 1000
  "correction": f64 = 0.02
  "bitsPerSample": i32 = 8
  "uLaw": bool
  "LDPC": bool
  "GeneratorMatrixLocation": path
panel indicators:
  "data": waveform<f64>[]
  "PacketGraph": cluster{"t0": f64, "dt": f64, "Y": c128[]}
  "IQ Graph": T3[]
  "numOfElementInRadioQueue2": i32
  "numOfElementInSoundQueue": i32
  "numOfElementInSoundQueue2": i32
  "numOfElementInRadioQueue": i32
  "loop iteration": i32
  "loop iteration_2": i32
  "loop iteration_3": i32
types:
  T1 = enum{"FSK", "PSK", "QAM", "MSK", "PAM", "ASK", "CPM"}
  T2 = enum{"none", "Raised Cosine", "Root Raised Cos", "Gaussian"}
  T3 = cluster{"constellation": f64[], "oversampled data": f64[]}
  T4 = cluster{"sample rate": f64, "number of channels": i32, "bits per sample": i32}
diagram:
  w1 = $LDPC
  w2 = $SamplesPerChannel
  w3 = $bitsPerSample
  w4 = $correction
  w5 = $multiple
  Obtain Queue(element data type=i8[] [], max queue size (-1, unlimited)=2000, name (unnamed)="sound_bit_stream") -> (error out=w6, queue out=w7)
  w8 = T4 {"sample rate"=6000, "number of channels"=1, "bits per sample"=16}
  call "Sound Input Configure.gvi"(device ID=0, sound format=w8, sample mode=1, number of samples per channel=8000) -> (task ID=w9, error out=w10)
  call "Sound Input Start.gvi"(task ID=w9, error in=w10) -> (task ID out=w11, error out=w12)
  call "Read from Spreadsheet File (DBL).gvi"(file path=$GeneratorMatrixLocation, format="%.3f", delimiter=",") -> (all rows=w13)
  while (iteration -> i1) {
    Multiply(w2, w3) -> w14
    call "Sound Input Read.gvi"(task ID=w11, error in=w12, number of samples per channel=w2, timeout=-1) -> (task ID out=w15, data=w16, error out=w17)
    for {
      w18 = each element of w16
      Property Node(instance in=w18) -> ("Y"=w19)
    }
    call "shiftAndMultSoundArray.gvi"(soundArray_raw=w19, correction=w4, multiply=w5) -> (processedSoundArray=w20)
    case ($uLaw) {
      frame False, Default {
        To Unsigned Byte Integer(number=w20) -> w21
      }
      frame True {
        call "uLawCodeArray16to8.gvi"(X=w20) -> (Y=w21)
      }
    }
    call "intArray2BitStream.gvi"(unsigned 8-bit integer=w21) -> (array=w22)
    Reshape Array(inArray=w22, size=w14) -> w23
    case (w1) {
      frame False, Default {
        w24 = w23
      }
      frame True {
        call "ldpcDenseCoding.gvi"(Message=w23, generatorMatrix=w13) -> (EncodedMessage=w24)
      }
    }
    call "createPacket.gvi"(dataBitStream=w24) -> (packet=w25)
    Get Queue Status(error in (no error)=w6, queue=w7) -> (# elements in queue=w26, error out=w27, queue out=w28)
    Lossy Enqueue Element(element=w25, error in (no error)=w27, queue=w28)
    $data <- w16
    $numOfElementInSoundQueue <- w26
    $"loop iteration" <- i1
    stop if $stopRecoringSound
  }
  call "Sound Input Stop.gvi"(task ID=w15, error in=w17) -> (task ID out=w29, error out=w30)
  call "Sound Input Clear.gvi"(task ID=w29, error in=w30)
  case (w1) {
    frame False, Default {
      w31 = $"samples per symbol"
    }
    frame True {
      Divide(x=$"samples per symbol", y=2) -> w32
      Round Toward Negative Infinity(x=w32) -> w31
    }
  }
  w33 = $"PSK type"
  w34 = $"modulation type"
  w35 = $"pulse shaping filter"
  w36 = $"filter parameter"
  w37 = $"filter length"
  w38 = cluster{"t0": f64, "dt": f64, "Y": c128[]} {"t0"=0, "dt"=1, "Y"=[]}
  Obtain Queue(element data type=w38, max queue size (-1, unlimited)=5000, name (unnamed)="enqueDataForRadio") -> (error out=w39, queue out=w40)
  call "niUSRP Open Tx Session.gvi"(Device names="192.168.10.2", Reset=TRUE) -> (Error Out=w41, Session handle=w42)
  call "niUSRP Configure Signal.gvi"(session handle=w42, IQ rate=$IQ_Rate, carrier frequency=$f0, gain=$Gain, error in (no error)=w41, active antenna="TX1") -> (session handle out=w43, coerced IQ rate=w44)
  while (iteration -> i2) {
    $"loop iteration_2" <- i2
    Get Queue Status(error in (no error)=w6, queue=w7) -> (# elements in queue=w45, error out=w46, queue out=w47)
    Dequeue Element(error in (no error)=w46, queue=w47) -> (element=w48, error out=w49, queue out=w50)
    call "modulation_block.gvi"(modulation type=w34, PSK type=w33, pulse shaping filter=w35, filter parameter=w36, filter length=w37, input bit stream=w48, samples per symbol=w31, IQ_Rate=w44) -> (modulated_complex_waveform=w51)
    Get Queue Status(error in (no error)=w49, queue=w40) -> (# elements in queue=w52, error out=w53, queue out=w54)
    Lossy Enqueue Element(element=w51, error in (no error)=w53, queue=w54)
    $numOfElementInSoundQueue2 <- w45
    $numOfElementInRadioQueue <- w52
    stop if $stopDataEnqueing
  }
  Flush Queue(queue=w50) -> (queue out=w55)
  Release Queue(queue=w55)
  while (iteration -> i3) {
    Get Queue Status(error in (no error)=w39, queue=w40) -> (# elements in queue=w56, error out=w57, queue out=w58)
    Dequeue Element(error in (no error)=w57, queue=w58) -> (element=w59, queue out=w60)
    call "addPadding.gvi"(dataIn=w59) -> (paddedDataOut=w61)
    call "niUSRP Write Tx Data (CDB Cluster).gvi"(session handle=w43, data=w61, end of data?=$stopSendingData) -> (session handle out=w62, Error Out=w63)
    $PacketGraph <- w61
    call "MT Format Constellation.gvi"(waveform=w61) -> (constellation graph=w64)
    $"IQ Graph" <- w64
    $numOfElementInRadioQueue2 <- w56
    $"loop iteration_3" <- i3
    stop if $stopSendingData
  }
  Flush Queue(queue=w60) -> (queue out=w65)
  Release Queue(queue=w65)
  call "niUSRP Close Session.gvi"(Handle in=w62, error in (no error)=w63)
