vi "Rx_bitstreamtosound.gvi"   [LabVIEW NXG]
panel controls:
  "queue_type": i16[]
  "stop": bool
types:
  T1 = cluster{"sample rate": f64, "number of channels": i32, "bits per sample": i32}
diagram:
  w1 = T1 {"sample rate"=8000, "number of channels"=1, "bits per sample"=16}
  call "Sound Output Configure.gvi"(device ID=0, sound format=w1, number of samples per channel=8000) -> (task ID=w2, error out=w3)
  call "Sound Output Start.gvi"(task ID=w2, error in=w3) -> (task ID out=w4, error out=w5)
  call "Sound Output Set Volume.gvi"(task ID=w4, volume=80, error in=w5) -> (task ID out=w6, error out=w7)
  Obtain Queue(element data type=$queue_type, max queue size (-1, unlimited)=200, name (unnamed)="bit_to_sound") -> (queue out=w8)
  while {
    Dequeue Element(queue=w8) -> (element=w9)
    for {
      w10 = each element of w9
      Is Not Equal To 0(x=w10) -> w12
      append w12 to w11
    }
    Array Size(array=w11) -> (size(s)=w13)
    Divide(x=w13, y=16) -> w14
    for (N = w14) (iteration -> i1) {
      Multiply(16, i1) -> w16
      Array Subset(array=w11, index0=w16, length0=16) -> w17
      Boolean Array To Number[SignExtensionMode=1](Boolean array=w17) -> (number=w18)
      append w18 to w15
    }
    To Word Integer(number=w15) -> w19
    Divide(x=w19, y=1000) -> w20
    Subtract(x=w20, y=0.3) -> w21
    Build Waveform Node(Y=w21, dt=0.000125) -> (output waveform=w22)
    Build Array(w22) -> w23
    call "Sound Output Write.gvi"(task ID=w6, data=w23, error in=w7, timeout=0) -> (task ID out=w24, error out=w25)
    stop if $stop
  }
  call "Sound Output Stop.gvi"(task ID=w24, error in=w25) -> (task ID out=w26, error out=w27)
  call "Sound Output Clear.gvi"(task ID=w26, error in=w27)
