vi "Tx_packetconstructor.gvi"   [LabVIEW NXG]
inputs:
  "User defined bitstream?": bool = TRUE
  "Packet Parameters": T1 = {"Guard Bits "=16, "Sync Bits"=32, "Message Bits"=960, "PN sequence order\nfor Sync"=9}
outputs:
  "Array": i8[]
panel controls:
  "Packet Number": i32
  "Cyclic Padding Bits": i32
  "bitstream": i8[] = [1]
  "stop": bool
panel indicators:
  "error out": error
  "size(s)": i32
types:
  T1 = cluster{"Guard Bits ": i32, "Sync Bits": i32, "Message Bits": i32, "PN sequence order\nfor Sync": i32}
diagram:
  Property Node(instance in=$"Packet Parameters") -> ("Sync Bits"=w1, "PN sequence order\nfor Sync"=w2, "Guard Bits "=w3, "Message Bits"=w4)
  call "MT Generate Bits (Galois, PN Order).gvi"(total bits=w1, PN sequence order=w2, reset?=TRUE) -> (output bit stream=w5, error out=w6)
  $"error out" <- w6
  Obtain Queue(element data type=$bitstream, name (unnamed)="Sound_to_bit") -> (queue out=w7)
  Get Queue Status(queue=w7) -> (queue out=w8)
  Dequeue Element(queue=w8) -> (element=w9)
  Array Size(array=w9) -> (size(s)=w10)
  Divide(x=w10, y=w4) -> w11
  To Long Integer(number=w11) -> w12
  Initialize Array(element=1, size=w3) -> w13
  for (N = w12) (iteration -> i1) {
    case ($"User defined bitstream?") {
      frame False, Default {
        call "MT Generate Bits (Galois, PN Order).gvi"(total bits=w4, PN sequence order=11) -> (output bit stream=w14)
      }
      frame True {
        Multiply(i1, w4) -> w15
        Array Subset(array=w9, index0=w15, length0=w4) -> w14
      }
    }
    Build Array[ConcatenateInputs=True](w13, w5, w14, w13) -> w16
    Array Subset(array=w14, length0=$"Cyclic Padding Bits")
  }
  $Array <- w16
  Array Size(array=w16) -> (size(s)=w17)
  $"size(s)" <- w17
