vi "Tx_soundtobitstream.gvi"   [LabVIEW NXG]
outputs:
  "appended array": i16[]
  "data": waveform<f64>[]
panel controls:
  "Packet Message Length (bits)": i32 = 128
  "stop": bool
panel indicators:
  "Array": i8[][]
  "File Length (bits)": i32
  "Number of Packets": i32
  "dt": f64
types:
  T1 = cluster{"sample rate": i32, "number of channels": i32, "bits per sample": i32}
diagram:
  w1 = T1 {"sample rate"=8000, "number of channels"=1, "bits per sample"=16}
  call "Sound Input Configure.gvi"(device ID=0, sound format=w1) -> (task ID=w2, error out=w3)
  call "Sound Input Start.gvi"(task ID=w2, error in=w3) -> (task ID out=w4, error out=w5)
  while {
    call "Sound Input Read.gvi"(task ID=w4, error in=w5) -> (task ID out=w6, data=w7, error out=w8)
    $data <- w7
    for {
      w9 = each element of w7
      Property Node(instance in=w9) -> ("Y"=w10, "dt"=w11)
      $dt <- w11
    }
    To Word Integer(number=w10) -> w12
    for {
      w13 = each element of w12
      Number To Boolean Array(number=w13) -> (Boolean array=w15)
      Boolean To Integer(Boolean=w15) -> (0, 1=w16)
      append w16 to w14
    }
    To Word Integer(number=w14) -> w17
    Array Size(array=w17) -> (size(s)=w18)
    Multiply Array Elements(numeric array=w18) -> (product=w19)
    Reshape Array(inArray=w17, size=w19) -> w20
    Array Size(array=w20) -> (size(s)=w21)
    Divide(x=w21, y=$"Packet Message Length (bits)") -> w22
    Round Toward Positive Infinity(x=w22) -> w23
    Multiply(w23, $"Packet Message Length (bits)") -> w24
    Subtract(x=w24, y=w21) -> w25
    To Long Integer(number=w25) -> w26
    Initialize Array(element=0, size=w26) -> w27
    Build Array[ConcatenateInputs=True](w20, w27) -> w28
    $"appended array" <- w28
    $Array <- w17
    $"File Length (bits)" <- w21
    To Long Integer(number=w23) -> w29
    $"Number of Packets" <- w29
    stop if $stop
  }
  call "Sound Input Stop.gvi"(task ID=w6, error in=w8) -> (task ID out=w30, error out=w31)
  call "Sound Input Clear.gvi"(task ID=w30, error in=w31)
